# Requirement set BMS_SRS (R2022b)
Software Requirements Document "Battery Management System (BMS)"

1. Introduction
1.1 Purpose
This document defines the software requirements for the Battery Management System (BMS). The BMS ensures safe, efficient, and reliable operation of a battery module comprising multiple cells.
1.2 Scope
The BMS software interfaces with the charger, inverter, and precharge circuit. It manages battery state estimation, fault detection, balancing, charging, discharging, and power distribution. The system supports a 3-cell battery pack.
1.3 Definitions, Acronyms, and Abbreviations
    * BMS: Battery Management System
    * SOC: State of Charge
    * SOH: State of Health
    * Vfb: Vehicle Feedback Interface
    * Stateflow: MATLAB tool for state machine modeling
    * Precharge Circuit: Safely charges capacitors on system startup

## 1 [#1] General Requirements (Container)

### 1.1 [#2] Battery Module Management (Container)

#### 1.1.1 [#3] Battary_No
The BMS shall manage the operation of a 3-cell battery module.

#### 1.1.2 [#4] Battary_Limit
The battery voltage shall operate within the range of 9V to 16.8V, in accordance with the safe operating limits of 3.0V - 4.2V lithium-ion battery cells.

### 1.2 [#5] Safety and Efficiency
The BMS shall detect and protect the battery from unsafe conditions such as over-voltage, under-voltage, over-temperature, and short circuits.

#### 1.2.1 [#6] Over-voltage
Over-voltage: 4.2V per cell (total 12.6V).

#### 1.2.2 [#7] Under-voltage
Under-voltage: 3.0V per cell (total 9.0V).

#### 1.2.3 [#8] Over-temperature
Over-temperature: 60°C.

#### 1.2.4 [#9] Under-temperature
Under-temperature: -20°C.

#### 1.2.5 [#10] Charging Over-Current
Charging Over-Current shall not exceed 15A maximum.

#### 1.2.6 [#11] Discharging Over-Current
Discharging Over-Current shall not exceed 30A maximum.

### 1.3 [#12] System Interfaces (Container)

#### 1.3.1 [#13] Charging and Discharging
The BMS shall regulate charging and discharging processes to maximize efficiency and extend battery life.

#### 1.3.2 [#22] System Interfaces
The BMS shall provide robust interfaces to support integration with external systems, including but not limited to chargers, inverters, and precharge circuits.

## 2 [#23] Functional Interfaces (Container)

### 2.1 [#14] BMS INPUTS (Container)
| Port Interface | Data Element | Type | Units | Description |
| VfbStateRequest | StateRequest | Enum | | Request from vehicle network |
| VfbCellVoltages | CellVoltage | Float32 | V | Voltage of each cell |
| VfbCellTemperatures | CellTemperature | Float32 | °C | Temperature of each cell |
| VfbPackVoltage | TotalPackVoltage | Float32 | V | Total voltage of battery pack |
| VfbPackCurrent | PackCurrent | Float32 | A | Current flowing through pack |
| VfbChargerVoltageOutput | ChargerOutputVoltage | Float32 | V | Output voltage from charger |
| VfbInverterVoltageOutput | InverterOutputVoltage | Float32 | V | Output voltage to inverter |

#### 2.1.1 [#15] State Request
The BMS shall accept a State Request from the vehicle network to define the operational state.
(State: Balancing-Charging-Driving)
| Name | Data Element | Data Type | Unit | Range |
| VfbStateRequest | StateRequest | Enum | | [0 : 2] |

#### 2.1.2 [#16] Cell Voltages
The BMS shall receive individual voltage measurements for each cell block (cells in series) at sample rate of 10KHz.
| Name | Data Element | Data Type | Unit | Range | Dimension |
| VfbCellVoltages | CellVoltage | Float32 | V | 0V to 5V per cell | # Cells |

#### 2.1.3 [#17] Cell Temperatures
The BMS shall receive temperature readings for each cell block (cells in series) at sample rate of 10KHz.
| Name | Data Element | Data Type | Unit | Range | Dimension |
| VfbCellTemperatures | CellTemperature | Float32 | °C | -10°C to 60°C | # Cells |

#### 2.1.4 [#18] Pack Voltage
The BMS shall receive the total voltage of the battery pack terminals (+Ve Batt and -Ve Batt) at sample rate of 10KHz.
| Name | Data Element | Data Type | Unit | Range |
| VfbPackVoltage | TotalPackVoltage | Float32 | V | 0V to 120V |

#### 2.1.5 [#19] Pack Current
The BMS shall receive the total current flowing through the battery pack at sample rate of 10KHz.
- VfbPackCurrent > 0 indicates battery pack charging.
- VfbPackCurrent < 0 indicates battery pack discharging.
| Name | Data Element | Data Type | Unit | Range |
| VfbPackCurrent | PackCurrent | Float32 | A | -30A to 30A |

#### 2.1.6 [#20] Charger Voltage
TheBMS shall receive the charger output voltage.
| Name | Data Element | Data Type | Unit | Range |
| VfbChargerVoltageOutput | ChargerOutputVoltage | Float32 | V | -180V to 180V |

#### 2.1.7 [#21] Inverter Voltage
The BMS shall receive the inverter output voltage.
| Name | Data Element | Data Type | Unit | Range |
| VfbInverterVoltageOutput | InverterOutputVoltage | Float32 | V | -180V to 180V |

### 2.2 [#26] BMS OUTPUTS (Container)
| Port Interface | Data Element | Type | Units | Description |
| VfbStateOfCharge | StateOfCharge | Float32 | % | Calculated state of charge |
| VfbBmsOperationalState | OperationalState | Enum | | Current operational state |
| VfbCurrentLimits | CurrentLimits | Float32 | A | Computed current limitations |
| VfbBalanceCommands | BalanceCommand | Boolean | | Commands to balance cell charge |
| VfbChargeCurrentCmd | ChargeCurrentCommand | Float32 | A | Command current for charging |
| VfbContactorCmds | ContactorCommand | Boolean | | Command‎s to manage contactors |

#### 2.2.1 [#27] State of Charge (SOC)
The BMS shall output the State of Charge (SOC) as a percentage of battery charge.
| Name | Data Element | Data Type | Unit | Range |
| VfbStateOfCharge | StateOfCharge | Float32 | % | 0% to 100% |

#### 2.2.2 [#28] Operational State
The BMS shall output the current operational state.
(State: Standby-Charging-Discharging-Fault)
| Name | Data Element | Data Type | Unit | Range |
| VfbBmsOperationalState | OperationalState | Enum | | [0 - 3] |

#### 2.2.3 [#29] Current Limits
The BMS shall output the calculated current limits.
| Name | Data Element | Data Type | Unit | Range |
| VfbCurrentLimits | CurrentLimits | Float32 | A | -30A to 30A |

#### 2.2.4 [#30] Balancing Commands
The BMS shall output a Boolean array indicating the cell balancing commands.
| Name | Data Element | Data Type | Unit | Range |
| VfbBalanceCommands | BalanceCommand | Boolean | | |

#### 2.2.5 [#31] Charge Current Command
The BMS shall output the current command for charging the battery.
| Name | Data Element | Data Type | Unit | Range |
| VfbChargeCurrentCmd | ChargeCurrentCommand | Float32 | A | 0A to 15A |

#### 2.2.6 [#32] Contactor Command
The BMS shall output a Boolean array indicating the contactor commands.
contactor for:
- Positive pole of the Charger
- Negative pole of the Charger
- Pre-charge of the Charger
- Positive pole of the Inverter
- Negative pole of the Inverter
- Pre-charge of the Inverter
| Name | Data Element | Data Type | Unit | Range |
| VfbContactorCmds | ContactorCommand | boolean | | |

## 3 [#33] Software Architecture
The BMS software shall have a modular architecture for easy maintenance and upgrades.
The BMS software shall be divided in this Modules:
1. Main State Machine
2. Current Limits Calculation
3. SOC/SOH Estimation
4. Balancing Logic

### 3.1 [#34] Main State Machine (Container)
The BMS shall execute the Main State Machine every 50 ms.
The Main State Machine has 4 main functionalities:
1. Manage the BMS status evolution on driving requests and safety
2. Calculate the correct charging mode
3. Monitors current, voltage and temperature faults for safty
4. Securely close and open the contacts to the charger and inverter

#### 3.1.1 [#71] BMS Main State Machine: Interfaces (Container)

##### 3.1.1.1 [#72] Inputs
BMS MAIN STATE MACHINE INPUTS
| Port Interface | Data Element | Type | Units | Description |
| VfbStateRequest | StateRequest | Enum | | Request from vehicle network |
| VfbCellVoltages | CellVoltage | Float32 | V | Voltage of each cell |
| VfbCellTemperatures | CellTemperature | Float32 | °C | Temperature of each cell |
| VfbPackVoltage | TotalPackVoltage | Float32 | V | Total voltage of battery pack |
| VfbPackCurrent | PackCurrent | Float32 | A | Current flowing through pack |
| VfbChargerVoltageOutput | ChargerOutputVoltage | Float32 | V | Output voltage from charger |
| VfbInverterVoltageOutput | InverterOutputVoltage | Float32 | V | Output voltage to inverter |
| VfbCurrentLimits | CurrentLimits | Float32 | A | Current Limits for safety |
| VfbMaxCellVoltage | MaxCellVoltage | Float32 | V | Max Cell Voltage Limits for safety |
| VfbMinCellVoltage | MinCellVoltage | Float32 | V | Max Voltage Limits for safety |

##### 3.1.1.2 [#73] Outputs
BMS MAIN STATE MACHINE OUTPUTS
| Port Interface | Data Element | Type | Units | Description |
| VfbBmsOperationalState | OperationalState | Enum | | Current operational state |
| VfbChargeCurrentReq | ChargeCurrentReq | Boolean | | Request to the charger |
| VfbContactorCmds | ContactorCommand | Boolean | | Commands to manage contactors |

#### 3.1.2 [#74] BMS State calculation
The Main State Machine shall support accurate state transitions between the BMS Mode (Standby - Charging - Driving - State) based on State Request, Relay Contactors States (Charger and Inverter), and Fault.

#### 3.1.3 [#75] Charging Mode calculation
The Main State Machine shall support accurate state transitions between the Chargin Mode (Init - Constant Current "CC" - Constant Voltage "CV")

#### 3.1.4 [#76] Relay Charger Commands
The Main State Machine shall support accurate Opening and closing for the Relays (Pre-charger, Positive, and Negative) for the Charger

#### 3.1.5 [#77] Relay Inverter Commands
The Main State Machine shall support accurate Opening and closing for the Relays (Pre-charger, Positive, and Negative) for the Inverter

#### 3.1.6 [#78] Fault Monitor Calculation
The Main State Machine shall detect the Faults of :
- Current Limitations "Over Current Pack Faut"
- Voltages Limitations "Over/Under Voltage Pack Faut"
- Temperature Limitaions "High/Low Cell Temperature Faut"

### 3.2 [#35] Current Limits Calculation
The BMS shall calculate current limits every 100 ms.
The Current Limit Calculation must calculate Minimum and Maximum Cell Voltage and the Current limits.

#### 3.2.1 [#79] BMS Current Limit Calculation: Interfaces (Container)

##### 3.2.1.1 [#80] Inputs
BMS CURRENT LIMIT CALCULATION INPUTS
| Port Interface | Data Element | Type | Units | Range |
| VfbCellVoltages | CellVoltage | Float32 | V | 3.0V to 4.2V per cell |
| VfbCellTemperatures | CellTemperature | Float32 | °C | -10°C to 60°C |

##### 3.2.1.2 [#81] Outputs
BMS CURRENT LIMIT CALCULATION OUTPUTS
| Port Interface | Data Element | Type | Units | Description |
| VfbCurrentLimits | CurrentLimits | Float32 | A | Current Limits for safety |
| VfbMaxCellVoltage | MaxCellVoltage | Float32 | V | Max Cell Voltage Limits for safety |
| VfbMinCellVoltage | MinCellVoltage | Float32 | V | Max Voltage Limits for safety |

#### 3.2.2 [#82] BMS Current Limit Calculation: Min/Max Calculation
The BMS shall calculate the Min/Max Voltages between cells.

#### 3.2.3 [#83] BMS Current Limit Calculation: Charge/Discharge Current Limit
The BMS shall calculate the Charge/Discharge Current Limit with ±0.01A resolution.

### 3.3 [#36] SOC Estimation
The BMS shall estimate SOC every 200 ms.
The State Of Carge Estimation shall estimate SOC with a resolution of 1% and accuracy of ±3%. (SOC_CC, SOC_KF, SOC_EKF).

#### 3.3.1 [#84] BMS SOC Estimation: Interfaces (Container)

##### 3.3.1.1 [#85] Inputs
BMS SOC ESTIMATION INPUTS
| Port Interface | Data Element | Type | Units | Description |
| VfbCellTemperatures | CellTemperature | Float32 | °C | Temperature of each cell |
| VfbCellVoltages | CellVoltage | Float32 | V | Voltage of each cell |
| VfbPackCurrent | PackCurrent | Float32 | A | Current flowing through pack |

##### 3.3.1.2 [#86] Outputs
BMS SOC ESTIMATION OUTPUTS
| Port Interface | Data Element | Type | Units | Description |
| VfbStateOfCharge | StateOfCharge | Float32 | % | Calculated state of charge |

#### 3.3.2 [#87] BMS SOC Estimation: Coulomb Counting
The BMS shall calculate the SOC with Coulomb Counting following the Req.

#### 3.3.3 [#88] BMS SOC Estimation: SOC OCV
The BMS shall drift correction of the SOC when the Battery resting with OCV following the Req.

##### 3.3.3.1 [#89] BMS SOC Estimation: SOC UKF, EKF (Informational)
The BMS shall calculate the SOC with UKF, and EKF following the Req.

### 3.4 [#37] SOH Estimation
The BMS shall estimate SOH every 200 ms.
The State Of Health Estimation shall estimate SOH with a resolution of 1% and accuracy of ±3%. (SOH_CC, SOH_KF, SOH_EKF).

#### 3.4.1 [#90] BMS SOH Estimation: Interfaces (Container)

##### 3.4.1.1 [#91] Inputs
BMS SOH ESTIMATION INPUTS
| Port Interface | Data Element | Type | Units | Description |
| VfbCellTemperatures | CellTemperature | Float32 | °C | Temperature of each cell |
| VfbCellVoltages | CellVoltage | Float32 | V | Voltage of each cell |
| VfbPackCurrent | PackCurrent | Float32 | A | Current flowing through pack |

##### 3.4.1.2 [#92] Outputs
BMS SOH ESTIMATION OUTPUTS
| Port Interface | Data Element | Type | Units | Description |
| VfbStateOfHealth | StateOfHealth | Float32 | % | Calculated state of charge |

#### 3.4.2 [#93] BMS SOH Estimation: Coulomb Counting
The BMS shall calculate the SOH with accumulted the Discharge charges following the Req.

##### 3.4.2.1 [#95] BMS SOH Estimation: SOC EKF (Informational)
The BMS shall calculate the SOH with EKF following the Req.

##### 3.4.2.2 [#94] BMS SOH Estimation: SOC UKF (Informational)
The BMS shall calculate the SOH with UKF following the Req.

### 3.5 [#38] Balancing Logic
The BMS shall execute balancing logic every 250 ms.
The Balancing Logic shall securely close and open the contacts to the charger and inverter.

#### 3.5.1 [#96] BMS Balancing Logic Interfaces (Container)

##### 3.5.1.1 [#97] Inputs
BMS BALANCING LOGIC INPUTS
| Port Interface | Data Element | Type | Units | Description |
| VfbStateRequest | StateRequest | Enum | | Request from vehicle network |
| VfbCellVoltages | CellVoltage | Float32 | V | Voltage of each cell |
| VfbMaxCellVoltage | MaxCellVoltage | Float32 | V | Max Cell Voltage Limits for safety |
| VfbMinCellVoltage | MinCellVoltage | Float32 | V | Max Voltage Limits for safety |

##### 3.5.1.2 [#98] Outputs
BMS BALANCING LOGIC OUTPUTS
| Port Interface | Data Element | Type | Units | Description |
| VfbBalanceCommands | BalanceCommand | Boolean | | Commands to balance cell charge |

#### 3.5.2 [#99] BMS Balancing Logic: Balancing Voltage Difference
The BMS shall balance cell levels when voltage difference exceeds the configured Threshold.
- Default Start Threshold Value: 25 mV (0.025 V)
- Default Stop Threshold Value: 10 mV (0.010 V)

#### 3.5.3 [#100] BMS Balancing Logic: Balancing ON/OFF
the Balancing Logic shall send the command to activate/deactivate the balancing Process.

### 3.6 [#66] User Interface (Container)

#### 3.6.1 [#105] User Interface: Monitoring and Configuration
The BMS shall provide a user interface that facilitates both monitoring of system status and configuration of operational parameters.

#### 3.6.2 [#106] User Interface: Alerts and Notifications
The BMS shall provide visual and audible alerts to notify users of any critical alarms or warnings.

#### 3.6.3 [#107] User Interface: Configuration
The BMS shall provide a user interface that enables users to configure settings, including charging profiles and fault thresholds.

#### 3.6.4 [#108] User Interface: Diagnostics
The BMS shall supply comprehensive diagnostic information to facilitate maintenance and troubleshooting activities.

## 4 [#39] Reliability and Maintainability (Container)

### 4.1 [#40] Self-Calibration
The BMS shall calibrate sensors at least every 48 hours or when temperature changes by 5°C.

### 4.2 [#41] Self-Diagnostics
The BMS shall perform self-diagnostics periodically to detect component failures.

### 4.3 [#65] Fault Tolerance (Container)
The BMS shall remain operational during minor component failures by employing fault-tolerant mechanisms.

#### 4.3.1 [#101] Voltage Cell Monitoring
The BMS shall monitor cell voltages in real time with Voltage accuracy: ±0.05V.

#### 4.3.2 [#102] Temperature Cell Monitoring
The BMS shall monitor cell temperatures in real time with Temperature accuracy: ±1°C.

#### 4.3.3 [#103] Package Currunt Monitoring
The BMS shall monitor Package Currunt in real time with Voltage accuracy: ±0.01A.

#### 4.3.4 [#104] Package Voltage Monitoring
The BMS shall monitor Package Voltage in real time with Voltage accuracy: ±0.1V.

## 5 [#60] Fault Notifications (Container)

### 5.1 [#61] Fault Detection
The BMS shall detect system fault event (specifically over-voltage, under-voltage, over-temperature, and short circuits).

### 5.2 [#62] Fault Response
The BMS shall initiate a response within 50 milliseconds of fault detection.

### 5.3 [#63] Fault Code
The BMS shall notify users of critical faults and provide error codes for troubleshooting.

### 5.4 [#64] Fault Notifications
The BMS shall provide notifications for system faults (e.g., over-voltage, short circuit) via both visual and audible alerts, with a response time of less than 100 ms.

## 6 [#42] Communication Requirements

### 6.1 [#43] Communication Protocols
The BMS shall support standard MODBUS communication protocols for interfacing with external devices (e.g., vehicle network, charger, inverter).

### 6.2 [#44] Communication Latency
The BMS shall ensure that communication latency does not exceed 100 milliseconds.

### 6.3 [#45] Communication Interfaces
The BMS shall have an API or diagnostic interface accessible via Bluetooth or USB for data logging, diagnostics, and system configuration.

### 6.4 [#46] Data Reporting
The BMS shall report key system parameters (SOC, temperature, voltage, current, etc.) to external devices in real-time.

### 6.5 [#111] Security (Container)

#### 6.5.1 [#112] Data Security
The BMS shall secure communication and data using Advanced Encryption Standard (AES).

#### 6.5.2 [#113] Access Control
The BMS shall incorporate robust access control mechanisms to prevent unauthorized access to its system functionalities and data.

## 7 [#47] Logging and Data Recording (Container)

### 7.1 [#48] Error Recording
The BMS shall log the error codes of the detected fault event.

### 7.2 [#55] Operational Data Recording
The BMS shall log operational data, including cell voltage, current, temperature, and SOC, with a minimum frequency of 1 Hz for analysis and diagnostics.

### 7.3 [#56] Recording Limit
Logs must be stored for a minimum of 30 days and should be accessible via diagnostic interfaces.

## 8 [#57] Software Updates (Container)

### 8.1 [#58] Updates_Req
The BMS shall support over-the-air (OTA) software updates with secure mechanisms to avoid unauthorized access.

### 8.2 [#59] Updates_Limit
Updates shall be applied with minimal downtime, not exceeding 30 seconds.

## 9 [#67] Acceptance Criteria (Container)

### 9.1 [#68] Functional Safety
The BMS shall be designed, implemented, and validated in accordance with the ISO 26262 functional safety standard, ensuring that all relevant safety measures and protocols are rigorously adhered to.

### 9.2 [#69] Regulatory Compliance
The BMS shall comply with all applicable regulatory requirements for automotive and energy storage applications by leveraging Model Advisor in accordance with MAAB guidelines, thereby ensuring full conformance with industry standards and governmental regulations.

### 9.3 [#70] Acceptance Criteria (Container)

#### 9.3.1 [#109] Real-World Performance
The BMS shall undergo rigorous testing in real-world scenarios, including edge cases such as high temperatures and sudden load changes, to validate its reliability and performance.

#### 9.3.2 [#110] Documentation and Independent Verification
Comprehensive test plans, procedures, and independent verification reports shall confirm that all acceptance criteria are met.