% Simulink data dictionary BMS_Arch_DD.sldd

VfbContactorCmds = mpt.Signal(StorageClass="ExportToFile", DataType="Bus: BMS_strContactorCmds", Unit="V")
VfbStateRequest = mpt.Signal(StorageClass="ImportedExtern", DataType="Enum: BMS_State_Enum", InitialValue="BMS_State_Enum.BMS_Standby")
VfbBmsOperationalState = mpt.Signal(StorageClass="ExportToFile", DataType="Enum: BMS_State_Enum", InitialValue="BMS_State_Enum.BMS_Standby")
VfbChargeCurrentReq = mpt.Signal(StorageClass="ExportToFile", DataType="single", Unit="A", InitialValue="0")

BMS_strContactorCmds = Simulink.Bus()
  ChargerPositivePole: boolean
  ChargerNegativePole: boolean
  ChargerPreCharge: boolean
  InverterPositivePole: boolean
  InverterNegativePole: boolean
  InverterPreCharge: boolean

VfbStateOfCharge = mpt.Signal(StorageClass="ExportToFile", DataType="single", Min=0, Max=100, Unit="%", InitialValue="0")
VfbStateOfHealth = mpt.Signal(StorageClass="ExportToFile", DataType="single", Min=0, Max=100, Unit="%", InitialValue="0")
BMS_Sw_CodeGenConfig = Simulink.ConfigSet(StartTime="0", StopTime="20000", Solver="FixedStepDiscrete", ProdHWDeviceType="ARM Compatible->ARM Cortex-M", SystemTargetFile="ert.tlc", TargetLang="C")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
VfbBalanceCommands = mpt.Signal(StorageClass="ExportToFile", DataType="boolean", InitialValue="false")
VfbCellVoltages = mpt.Signal(StorageClass="ImportedExtern", DataType="single", Min=0, Max=5, Unit="V")
VfbCellTemperatures = mpt.Signal(StorageClass="ImportedExtern", DataType="single", Min=-10, Max=60, Unit="°C")
VfbInverterVoltageOutput = mpt.Signal(StorageClass="ImportedExtern", DataType="single", Min=-180, Max=180, Unit="V", InitialValue="0")
VfbChargerVoltageOutput = mpt.Signal(StorageClass="ImportedExtern", DataType="single", Min=-180, Max=180, Unit="V", InitialValue="0")
VfbPackCurrent = mpt.Signal(StorageClass="ImportedExtern", DataType="single", Min=-30, Max=30, Unit="A", InitialValue="0")
VfbPackVoltage = mpt.Signal(StorageClass="ImportedExtern", DataType="single", Min=0, Max=120, Unit="V", InitialValue="0")
VfbMinCellVoltage = mpt.Signal(StorageClass="ImportedExtern", DataType="single", Min=0, Max=5, Unit="V", InitialValue="0")
VfbMaxCellVoltage = mpt.Signal(StorageClass="ImportedExtern", DataType="single", Min=0, Max=5, Unit="V", InitialValue="0")
VfbCurrentLimits = mpt.Signal(StorageClass="ExportToFile", DataType="single", Min=-30, Max=30, Unit="A")
VfbFaultCode = mpt.Signal(StorageClass="ExportToFile", DataType="uint8", Min=0, Max=255, InitialValue="0")