% Requirement links of BMS_BalancingLogic_COM_TestManager.mldatx (R2022b)

item 1 verifies BMS_SRS.slreqx#38
item 2 verifies BMS_SRS.slreqx#38: Balancing Logic
item 3 verifies BMS_SRS.slreqx#97: Inputs
item 3 verifies BMS_SRS.slreqx#98: Outputs
item 3 verifies BMS_SRS.slreqx#100: BMS Balancing Logic: Balancing ON/OFF
item 4 verifies BMS_SRS.slreqx#97: Inputs
item 4 verifies BMS_SRS.slreqx#98: Outputs
item 4 verifies BMS_SRS.slreqx#100: BMS Balancing Logic: Balancing ON/OFF
item 4 verifies BMS_SRS.slreqx#99: BMS Balancing Logic: Balancing Voltage Difference
item 5 verifies BMS_SRS.slreqx#97: Inputs
item 5 verifies BMS_SRS.slreqx#98: Outputs
item 5 verifies BMS_SRS.slreqx#100: BMS Balancing Logic: Balancing ON/OFF
item 5 verifies BMS_SRS.slreqx#99
item 6 verifies BMS_SRS.slreqx#97
item 6 verifies BMS_SRS.slreqx#98
item 6 verifies BMS_SRS.slreqx#100