test file "BMS_CurrentLimitsCalc_COM_TestManager"
  coverage: Decision

suite "MIL"

  case "New Test Case 1" [baseline]
    model BMS_CurrentLimitsCalc_COM, harness BMS_CurrentLimitsCalc_COM_Harness_MIL (for BMS_CurrentLimitsCalc_COM/BMS_CurrentLimitsCalc_Runnable), mode Normal, stop time 4
    test sequence scenario: StaticBoundary (BMS_CurrentLimitsCalc_COM_Harness_MIL/Test Sequence)

  case "New Test Case 2" [baseline]
    model BMS_CurrentLimitsCalc_COM, harness BMS_CurrentLimitsCalc_COM_Harness_MIL (for BMS_CurrentLimitsCalc_COM/BMS_CurrentLimitsCalc_Runnable), mode Normal, stop time 4
    test sequence scenario: RandamTests (BMS_CurrentLimitsCalc_COM_Harness_MIL/Test Sequence)

  case "New Test Case 3" [baseline]
    model BMS_CurrentLimitsCalc_COM, harness BMS_CurrentLimitsCalc_COM_Harness_MIL (for BMS_CurrentLimitsCalc_COM/BMS_CurrentLimitsCalc_Runnable), mode Normal, stop time 4
    test sequence scenario: RampTests (BMS_CurrentLimitsCalc_COM_Harness_MIL/Test Sequence)

suite "SIL"

  case "New Test Case 1" [baseline]
    model BMS_CurrentLimitsCalc_COM, harness BMS_CurrentLimitsCalc_COM_Harness_SIL (for BMS_CurrentLimitsCalc_COM/BMS_CurrentLimitsCalc_Runnable), mode Normal, stop time 4
    test sequence scenario: StaticBoundary (BMS_CurrentLimitsCalc_COM_Harness_SIL/Test Sequence)

  case "New Test Case 2" [baseline]
    model BMS_CurrentLimitsCalc_COM, harness BMS_CurrentLimitsCalc_COM_Harness_SIL (for BMS_CurrentLimitsCalc_COM/BMS_CurrentLimitsCalc_Runnable), mode Normal, stop time 4
    test sequence scenario: RandamTests (BMS_CurrentLimitsCalc_COM_Harness_SIL/Test Sequence)

  case "New Test Case 3" [baseline]
    model BMS_CurrentLimitsCalc_COM, harness BMS_CurrentLimitsCalc_COM_Harness_SIL (for BMS_CurrentLimitsCalc_COM/BMS_CurrentLimitsCalc_Runnable), mode Normal, stop time 4
    test sequence scenario: RampTests (BMS_CurrentLimitsCalc_COM_Harness_SIL/Test Sequence)