% Requirement links of BMS_CurrentLimitsCalc_COM_TestManager.mldatx (R2022b)

item 1 verifies BMS_CurrentLimitsCalc_COM.slx: BMS_CurrentLimitsCalc_COM_Harness_MIL/Test Sequence (Test Sequence)
item 2 verifies BMS_SRS.slreqx#80: Inputs
item 2 verifies BMS_SRS.slreqx#81: Outputs
item 2 verifies BMS_SRS.slreqx#82: BMS Current Limit Calculation: Min/Max Calculation
item 2 verifies BMS_SRS.slreqx#83: BMS Current Limit Calculation: Charge/Discharge Current Limit
item 3 verifies BMS_SRS.slreqx#35
item 4 verifies BMS_SRS.slreqx#80: Inputs
item 4 verifies BMS_SRS.slreqx#81: Outputs
item 4 verifies BMS_SRS.slreqx#82: BMS Current Limit Calculation: Min/Max Calculation
item 5 verifies BMS_SRS.slreqx#35
item 6 verifies BMS_SRS.slreqx#80: Inputs
item 7 verifies BMS_SRS.slreqx#80: Inputs
item 7 verifies BMS_SRS.slreqx#81: Outputs
item 7 verifies BMS_SRS.slreqx#82
item 7 verifies BMS_SRS.slreqx#83
item 8 verifies BMS_SRS.slreqx#80: Inputs
item 8 verifies BMS_SRS.slreqx#81: Outputs
item 8 verifies BMS_SRS.slreqx#82
item 9 verifies BMS_SRS.slreqx#80: Inputs
item 10 verifies BMS_CurrentLimitsCalc_COM.slx: BMS_CurrentLimitsCalc_COM_Harness_MIL/Test Sequence (Test Sequence)