test file "BMS_EstimateSOC_COM_TestManager"
  coverage: Decision

suite "MIL"

  case "New Test Case 1" [baseline]
    model BMS_EstimateSOC_COM, harness BMS_EstimateSOC_COM_Harness_MIL (for BMS_EstimateSOC_COM/BMS_EstimateSOC_Runnable), start time 0, stop time 100
    test sequence scenario: Cold_Start (BMS_EstimateSOC_COM_Harness_MIL/Test Sequence)

  case "New Test Case 2" [baseline]
    model BMS_EstimateSOC_COM, harness BMS_EstimateSOC_COM_Harness_MIL (for BMS_EstimateSOC_COM/BMS_EstimateSOC_Runnable), start time 0, stop time 100
    test sequence scenario: High_Puls_Discharge (BMS_EstimateSOC_COM_Harness_MIL/Test Sequence)

  case "New Test Case 3" [baseline]
    model BMS_EstimateSOC_COM, harness BMS_EstimateSOC_COM_Harness_MIL (for BMS_EstimateSOC_COM/BMS_EstimateSOC_Runnable), start time 0, stop time 100
    test sequence scenario: Regenerative_Braking (BMS_EstimateSOC_COM_Harness_MIL/Test Sequence)

  case "New Test Case 4" [baseline]
    model BMS_EstimateSOC_COM, harness BMS_EstimateSOC_COM_Harness_MIL (for BMS_EstimateSOC_COM/BMS_EstimateSOC_Runnable), start time 0, stop time 100
    test sequence scenario: Idle_Rest (BMS_EstimateSOC_COM_Harness_MIL/Test Sequence)

  case "New Test Case 5" [baseline]
    model BMS_EstimateSOC_COM, harness BMS_EstimateSOC_COM_Harness_MIL (for BMS_EstimateSOC_COM/BMS_EstimateSOC_Runnable), start time 0, stop time 100
    test sequence scenario: Dynamic_Test (BMS_EstimateSOC_COM_Harness_MIL/Test Sequence)

suite "SIL"

  case "New Test Case 1" [baseline]
    model BMS_EstimateSOC_COM, harness BMS_EstimateSOC_COM_Harness_MIL (for BMS_EstimateSOC_COM/BMS_EstimateSOC_Runnable), start time 0, stop time 100
    test sequence scenario: Cold_Start (BMS_EstimateSOC_COM_Harness_MIL/Test Sequence)

  case "New Test Case 2" [baseline]
    model BMS_EstimateSOC_COM, harness BMS_EstimateSOC_COM_Harness_MIL (for BMS_EstimateSOC_COM/BMS_EstimateSOC_Runnable), start time 0, stop time 100
    test sequence scenario: High_Puls_Discharge (BMS_EstimateSOC_COM_Harness_MIL/Test Sequence)

  case "New Test Case 3" [baseline]
    model BMS_EstimateSOC_COM, harness BMS_EstimateSOC_COM_Harness_MIL (for BMS_EstimateSOC_COM/BMS_EstimateSOC_Runnable), start time 0, stop time 100
    test sequence scenario: Regenerative_Braking (BMS_EstimateSOC_COM_Harness_MIL/Test Sequence)

  case "New Test Case 4" [baseline]
    model BMS_EstimateSOC_COM, harness BMS_EstimateSOC_COM_Harness_MIL (for BMS_EstimateSOC_COM/BMS_EstimateSOC_Runnable), start time 0, stop time 100
    test sequence scenario: Idle_Rest (BMS_EstimateSOC_COM_Harness_MIL/Test Sequence)

  case "New Test Case 5" [baseline]
    model BMS_EstimateSOC_COM, harness BMS_EstimateSOC_COM_Harness_MIL (for BMS_EstimateSOC_COM/BMS_EstimateSOC_Runnable), start time 0, stop time 100
    test sequence scenario: Dynamic_Test (BMS_EstimateSOC_COM_Harness_MIL/Test Sequence)