% Requirement links of BMS_EstimateSOC_COM_TestManager.mldatx (R2022b)

item 1 verifies BMS_SRS.slreqx#36
item 1 verifies BMS_SRS.slreqx#37
item 2 verifies BMS_SRS.slreqx#36
item 2 verifies BMS_SRS.slreqx#37
item 3 verifies BMS_SRS.slreqx#85: Inputs
item 3 verifies BMS_SRS.slreqx#88: BMS SOC Estimation: SOC OCV
item 3 verifies BMS_SRS.slreqx#86: Outputs
item 4 verifies BMS_SRS.slreqx#85: Inputs
item 4 verifies BMS_SRS.slreqx#86: Outputs
item 4 verifies BMS_SRS.slreqx#87: BMS SOC Estimation: Coulomb Counting
item 4 verifies BMS_SRS.slreqx#92
item 4 verifies BMS_SRS.slreqx#91
item 5 verifies BMS_SRS.slreqx#85: Inputs
item 5 verifies BMS_SRS.slreqx#88: BMS SOC Estimation: SOC OCV
item 5 verifies BMS_SRS.slreqx#86: Outputs
item 5 verifies BMS_SRS.slreqx#87: BMS SOC Estimation: Coulomb Counting
item 6 verifies BMS_SRS.slreqx#85: Inputs
item 6 verifies BMS_SRS.slreqx#88: BMS SOC Estimation: SOC OCV
item 6 verifies BMS_SRS.slreqx#86
item 7 verifies BMS_SRS.slreqx#85: Inputs
item 7 verifies BMS_SRS.slreqx#88
item 7 verifies BMS_SRS.slreqx#86
item 8 verifies BMS_SRS.slreqx#85: Inputs
item 8 verifies BMS_SRS.slreqx#86: Outputs
item 8 verifies BMS_SRS.slreqx#87: BMS SOC Estimation: Coulomb Counting
item 8 verifies BMS_SRS.slreqx#92: Outputs
item 8 verifies BMS_SRS.slreqx#91: Inputs
item 9 verifies BMS_SRS.slreqx#85: Inputs
item 9 verifies BMS_SRS.slreqx#88: BMS SOC Estimation: SOC OCV
item 9 verifies BMS_SRS.slreqx#86: Outputs
item 10 verifies BMS_SRS.slreqx#85: Inputs
item 10 verifies BMS_SRS.slreqx#88: BMS SOC Estimation: SOC OCV
item 10 verifies BMS_SRS.slreqx#86
item 10 verifies BMS_SRS.slreqx#87
item 11 verifies BMS_SRS.slreqx#85: Inputs
item 11 verifies BMS_SRS.slreqx#86: Outputs
item 11 verifies BMS_SRS.slreqx#87: BMS SOC Estimation: Coulomb Counting
item 11 verifies BMS_SRS.slreqx#88: BMS SOC Estimation: SOC OCV
item 11 verifies BMS_SRS.slreqx#93: BMS SOH Estimation: Coulomb Counting
item 11 verifies BMS_SRS.slreqx#91: Inputs
item 11 verifies BMS_SRS.slreqx#92: Outputs
item 12 verifies BMS_SRS.slreqx#85: Inputs
item 12 verifies BMS_SRS.slreqx#86: Outputs
item 12 verifies BMS_SRS.slreqx#87: BMS SOC Estimation: Coulomb Counting
item 12 verifies BMS_SRS.slreqx#88: BMS SOC Estimation: SOC OCV
item 12 verifies BMS_SRS.slreqx#93: BMS SOH Estimation: Coulomb Counting
item 12 verifies BMS_SRS.slreqx#91: Inputs
item 12 verifies BMS_SRS.slreqx#92: Outputs