test file "BMS_MainStateMachine_COM_TestManager"
  coverage: Decision

suite "MIL"

  case "New Test Case 1" [baseline]
    model BMS_MainStateMachine_COM, harness BMS_MainStateMachine_COM_Harness_MIL (for BMS_MainStateMachine_COM/BMS_MainStateMachine_Runnable), start time 0, stop time 10

  case "New Test Case 2" [baseline]
    model BMS_MainStateMachine_COM, harness BMS_MainStateMachine_COM_Harness_MIL (for BMS_MainStateMachine_COM/BMS_MainStateMachine_Runnable), start time 0, stop time 10

  case "New Test Case 3" [baseline]
    model BMS_MainStateMachine_COM, harness BMS_MainStateMachine_COM_Harness_MIL (for BMS_MainStateMachine_COM/BMS_MainStateMachine_Runnable), start time 0, stop time 10

  case "New Test Case 4" [baseline]
    model BMS_MainStateMachine_COM, harness BMS_MainStateMachine_COM_Harness_MIL (for BMS_MainStateMachine_COM/BMS_MainStateMachine_Runnable), start time 0, stop time 10

  case "New Test Case 5" [baseline]
    model BMS_MainStateMachine_COM, harness BMS_MainStateMachine_COM_Harness_MIL (for BMS_MainStateMachine_COM/BMS_MainStateMachine_Runnable), start time 0, stop time 10

suite "SIL"

  case "New Test Case 1" [baseline]
    model BMS_MainStateMachine_COM, harness BMS_MainStateMachine_COM_Harness_MIL (for BMS_MainStateMachine_COM/BMS_MainStateMachine_Runnable), start time 0, stop time 10

  case "New Test Case 2" [baseline]
    model BMS_MainStateMachine_COM, harness BMS_MainStateMachine_COM_Harness_MIL (for BMS_MainStateMachine_COM/BMS_MainStateMachine_Runnable), start time 0, stop time 10

  case "New Test Case 3" [baseline]
    model BMS_MainStateMachine_COM, harness BMS_MainStateMachine_COM_Harness_MIL (for BMS_MainStateMachine_COM/BMS_MainStateMachine_Runnable), start time 0, stop time 10

  case "New Test Case 4" [baseline]
    model BMS_MainStateMachine_COM, harness BMS_MainStateMachine_COM_Harness_MIL (for BMS_MainStateMachine_COM/BMS_MainStateMachine_Runnable), start time 0, stop time 10

  case "New Test Case 5" [baseline]
    model BMS_MainStateMachine_COM, harness BMS_MainStateMachine_COM_Harness_MIL (for BMS_MainStateMachine_COM/BMS_MainStateMachine_Runnable), start time 0, stop time 10