% Requirement links of BMS_MainStateMachine_COM_TestManager.mldatx (R2022b)

item 1 verifies BMS_SRS.slreqx#74: BMS State calculation
item 1 verifies BMS_SRS.slreqx#72: Inputs
item 1 verifies BMS_SRS.slreqx#73: Outputs
item 1 verifies BMS_SRS.slreqx#77
item 2 verifies BMS_SRS.slreqx#74: BMS State calculation
item 2 verifies BMS_SRS.slreqx#72: Inputs
item 2 verifies BMS_SRS.slreqx#73: Outputs
item 2 verifies BMS_SRS.slreqx#75: Charging Mode calculation
item 3 verifies BMS_SRS.slreqx#74: BMS State calculation
item 3 verifies BMS_SRS.slreqx#72: Inputs
item 3 verifies BMS_SRS.slreqx#73: Outputs
item 3 verifies BMS_SRS.slreqx#75
item 4 verifies BMS_SRS.slreqx#74: BMS State calculation
item 4 verifies BMS_SRS.slreqx#72: Inputs
item 4 verifies BMS_SRS.slreqx#73: Outputs
item 5 verifies BMS_SRS.slreqx#74: BMS State calculation
item 5 verifies BMS_SRS.slreqx#72: Inputs
item 5 verifies BMS_SRS.slreqx#73: Outputs
item 5 verifies BMS_SRS.slreqx#77: Relay Inverter Commands
item 6 verifies BMS_SRS.slreqx#74: BMS State calculation
item 6 verifies BMS_SRS.slreqx#72: Inputs
item 6 verifies BMS_SRS.slreqx#73: Outputs
item 6 verifies BMS_SRS.slreqx#76
item 7 verifies BMS_SRS.slreqx#74: BMS State calculation
item 7 verifies BMS_SRS.slreqx#72: Inputs
item 7 verifies BMS_SRS.slreqx#73: Outputs
item 7 verifies BMS_SRS.slreqx#77: Relay Inverter Commands
item 7 verifies BMS_SRS.slreqx#78: Fault Monitor Calculation
item 8 verifies BMS_SRS.slreqx#74: BMS State calculation
item 8 verifies BMS_SRS.slreqx#72: Inputs
item 8 verifies BMS_SRS.slreqx#73: Outputs
item 8 verifies BMS_SRS.slreqx#77
item 8 verifies BMS_SRS.slreqx#78
item 9 verifies BMS_SRS.slreqx#74
item 9 verifies BMS_SRS.slreqx#72
item 9 verifies BMS_SRS.slreqx#73
item 10 verifies BMS_SRS.slreqx#74: BMS State calculation
item 10 verifies BMS_SRS.slreqx#72: Inputs
item 10 verifies BMS_SRS.slreqx#73: Outputs
item 10 verifies BMS_SRS.slreqx#76: Relay Charger Commands